# Dynamo graph test.dyn "DailyMinimal661_b" (Dynamo 2.10.0.3455)
# packages: Buildz_Plotter 0.0.1, Firefly 0.2.0

# group: Inputs
numberSegments = DoubleSlider(31, range=10..100 step 1)  # graph input
seed = DoubleSlider(7, range=0..100 step 1)  # graph input
rounding = IntegerSlider(0, range=0..3 step 1)

# group: Random arrangement of points
code_block = CodeBlock { 0; 359; 1; 10; }
code_block_2 = CodeBlock(seed=seed) { seed+0; seed+1; }
randomList = Math.RandomList(amount=numberSegments, value1=code_block.out0, value2=code_block.out1, seed=code_block_2.out0)
round = Math.Round(number=randomList, digits=rounding)
randomList_2 = Math.RandomList(amount=numberSegments, value1=code_block.out2, value2=code_block.out3, seed=code_block_2.out1)
round_2 = Math.Round(number=randomList_2, digits=rounding)
byCylindricalCoordinates = Point.ByCylindricalCoordinates(angle=round, radius=round_2)

# group: Revolve Angles
code_block_3 = CodeBlock(seed=seed) { 1; 30; seed+3; }
randomList_3 = Math.RandomList(amount=numberSegments, value1=code_block_3.out0, value2=code_block_3.out1, seed=code_block_3.out2)
round_3 = Math.Round(number=randomList_3)
code_block_4 = CodeBlock(n=round_3) { n*3; }

# group: Wedges
byCoordinates = Point.ByCoordinates()
byTwoPoints = Vector.ByTwoPoints(start=byCoordinates, end=byCylindricalCoordinates)
code_block_5 = CodeBlock(seed=seed) { 1; 10; seed+2; }
randomList_4 = Math.RandomList(amount=numberSegments, value1=code_block_5.out0, value2=code_block_5.out1, seed=code_block_5.out2)
round_4 = Math.Round(number=randomList_4, digits=rounding)
byStartPointDirectionLength = Line.ByStartPointDirectionLength(startPoint=byCylindricalCoordinates, direction=byTwoPoints, length=round_4)
byRevolve = Surface.ByRevolve(profile=byStartPointDirectionLength, sweepAngle=code_block_4)

# group: Extrude surfaces to random, stepped levels and union
code_block_6 = CodeBlock(seed=seed) { 0.1; 0.5; seed+4; }
randomList_5 = Math.RandomList(amount=numberSegments, value1=code_block_6.out0, value2=code_block_6.out1, seed=code_block_6.out2)
code_block_7 = CodeBlock { 1; }
round_5 = Math.Round(number=randomList_5, digits=code_block_7)
code_block_8 = CodeBlock { false; }
thicken = Surface.Thicken(surface=byRevolve, thickness=round_5, both_sides=code_block_8)
byUnion = Solid.ByUnion(solids=thicken)

# group: Get all the top faces and move them to a shared plane
explode = Geometry.Explode(geometry=byUnion)
normalAtParameter = Surface.NormalAtParameter(surface=explode)
Z = Vector.Z(vector=normalAtParameter)
code_block_9 = CodeBlock { 1; }
eq = Z == code_block_9
filterByBoolMask = List.FilterByBoolMask(list=explode, mask=eq)
pointAtParameter = Surface.PointAtParameter(surface=filterByBoolMask.in)
Z_2 = Point.Z(point=pointAtParameter)
code_block_10 = CodeBlock(z=Z_2) { -z; }
translate = Geometry.Translate(geometry=filterByBoolMask.in, zTranslation=code_block_10)

# group: Trim the edges away from each other
thicken_2 = Surface.Thicken(surface=translate)
code_block_11 = CodeBlock { 0.3; }
thinShell = Solid.ThinShell(solid=thicken_2, internalFaceThickness=code_block_11, externalFaceThickness=code_block_11)
subtractFrom = Surface.SubtractFrom(surface=translate, trimmingEntity=thinShell)

# group: Visualization
code_block_12 = CodeBlock { 30; }
translate_2 = Geometry.Translate(geometry=subtractFrom, xTranslation=code_block_12, yTranslation=code_block_12)
color_palette = ColorPalette({R: 0, G: 0, B: 0, A: 255})
byGeometryColor = Modifiers.GeometryColor.ByGeometryColor(geometry=translate_2, color=color_palette)

edges = Topology.Edges(topology=subtractFrom)
curveGeometry = Edge.CurveGeometry(edge=edges)
code_block_13 = CodeBlock { -20..20..#200; -20..20..#2; }
byCoordinates_2 = Point.ByCoordinates(x=code_block_13.out0, y=code_block_13.out1, lacing=CrossProduct)
bostrophodontic = Custom[bostrophodontic](list=byCoordinates_2)  # package Buildz_Plotter
flatten = List.Flatten(list=bostrophodontic@L2)
byPoints = PolyCurve.ByPoints(points=flatten)
byOriginNormal = Plane.ByOriginNormal()
code_block_14 = CodeBlock { 33; }
rotate = Geometry.Rotate(geometry=byPoints, basePlane=byOriginNormal, degrees=code_block_14)
intersect = Geometry.Intersect(geometry=subtractFrom, other=rotate, lacing=CrossProduct)
code_block_15 = CodeBlock { false; }
clean = List.Clean(list=intersect, preserveIndices=code_block_15)
code_block_16 = CodeBlock { 0.05; }
byCenterPointRadius = Circle.ByCenterPointRadius(radius=code_block_16)
list_create = List.Create(item0=curveGeometry, item1=clean, item2=byCenterPointRadius)
code_block_17 = CodeBlock { 10; }  # frozen

# group: Export to SVG
deconstruct = List.Deconstruct(list=list_create)
code_block_18 = CodeBlock { "C:\\Users\\kronz\\Dropbox\\RoboDraws\\DailyMinimal661"; }
code_block_19 = CodeBlock(segments=numberSegments, seed=seed, offset=code_block_11) { segments+ "_" +seed+"_" +offset+"_Minimal661"; }
SVG_LayerExport = Custom[SVG_LayerExport](RegistrationCurves=deconstruct.first, exportLocation=code_block_18, fileName=code_block_19, viewportWidth=code_block_17, viewportHeight=code_block_17, DrawingCurves=deconstruct.rest)  # package Buildz_Plotter

code_block_20 = CodeBlock { 1; 100; 30000; }
faderOneWay = Firefly.Utility.FaderOneWay(From=code_block_20.out0, To=code_block_20.out1, Time=code_block_20.out2)
code_block_21 = CodeBlock(a=faderOneWay, b=faderOneWay) { a; b; }
perimeterCurves = Surface.PerimeterCurves()  # unwired: surface
